# Grasshopper definition Write-gcode-ver2.ghx (Grasshopper 0.9.76)
# plug-ins: Python Interpreter, GH_CPython

# ---- group: W
number_slider = Slider(20, range=0..100)

# ----
number_slider_2 = Slider(150, range=0..1000)

# ---- group: Margin
number_slider_3 = Slider(25, range=1..200)

# ---- group: size
panel = Panel("500")

# ---- group: layer_count
number_slider_4 = Slider(175, range=1..350)

# ---- group: layer_height
number_slider_5 = Slider(1.5, range=0.1..30)

# ----
rectangle = Rectangle(Plane=PlaneXY(0, 0, 0), XSize="0 to 800", YSize="0 to 800", Radius=0)  # -> Rectangle, Length
crv = Curve(rectangle.Rectangle)

rectangle_2 = Rectangle(Plane=PlaneXY(0, 0, 0), XSize="200 to 600", YSize="200 to 600", Radius=0)  # -> Rectangle, Length
crv_2 = Curve(rectangle_2.Rectangle)

multiplication = Multiplication(A=number_slider_4, B=number_slider_5)
neg = Negative(Value=number_slider_3)
division = Division(A=panel, B=number_slider)
addition = Addition(A=panel, B=number_slider_3)
multiplication_2 = Multiplication(A=multiplication, B="2")
Y = UnitY(Factor=neg)
pt = ConstructPoint(XCoordinate=number_slider_2, YCoordinate=number_slider_2, ZCoordinate=0)
addition_2 = Addition(A=addition, B=number_slider_3)
neg_2 = Negative(Value=addition_2)

# ---- group: Printing Height
panel_2 = Panel(multiplication_2)

# ----
Y_2 = UnitY(Factor=addition)
X = UnitX(Factor=number_slider)
Y_3 = UnitY(Factor=neg_2)
preview = CustomPreview(Geometry=crv, Shader=ColourSwatch(SwatchColor=RGB(255, 255, 255)))
move = Move(Geometry=pt, Motion=Y)  # -> Geometry, Transform
move_2 = Move(Geometry=pt, Motion=Y_2)  # -> Geometry, Transform
move_3 = Move(Geometry=move_2.Geometry, Motion=X)  # -> Geometry, Transform
move_4 = Move(Geometry=move_3.Geometry, Motion=Y_3)  # -> Geometry, Transform
move_5 = Move(Geometry=move_4.Geometry, Motion=X)  # -> Geometry, Transform
integer_division = IntegerDivision(A=division, B="2")
merge = Merge(Data1=move.Geometry, Data2=move_2.Geometry, Data3=move_3.Geometry, Data4=move_4.Geometry, Data5=move_5.Geometry)
multiplication_3 = Multiplication(A=number_slider, B="2")
series = Series(Start=0, Step=multiplication_3, Count=integer_division)
pline = PolyLine(Vertices=merge, Closed=False)
X_2 = UnitX(Factor=series)
move_6 = Move(Geometry=pline, Motion=X_2)  # -> Geometry, Transform
join = JoinCurves(Curves=move_6.Geometry, Preserve=False)
bbox = BoundingBox(Content=join, Plane=PlaneXY(0, 0, 0))  # -> Box, Box_2
area = Area(Geometry=bbox.Box_2)  # -> Area, Centroid
pdecon = Deconstruct(Point=area.Centroid)  # -> XComponent, YComponent, ZComponent
pt_2 = ConstructPoint(XCoordinate=pdecon.XComponent, YCoordinate=pdecon.YComponent, ZCoordinate=0)
rotate = Rotate(Geometry=join, Angle="0.5 * pi", Plane=pt_2)  # -> Geometry, Transform
disc = Discontinuity(Curve=join, Level=1)  # -> Points, Parameters
shatter = Shatter(Curve=join, Parameters=disc.Parameters)
disc_2 = Discontinuity(Curve=rotate.Geometry, Level=1)  # -> Points, Parameters
shatter_2 = Shatter(Curve=rotate.Geometry, Parameters=disc_2.Parameters)
len = Length(Curve=shatter)
len_2 = Length(Curve=shatter_2)
lng = ListLength(List=len)
pdecon_2 = Deconstruct(Point=disc.Points)  # -> XComponent, YComponent, ZComponent
pdecon_3 = Deconstruct(Point=disc_2.Points)  # -> XComponent, YComponent, ZComponent
panel_3 = Panel(lng)
lng_2 = ListLength(List=len_2)
panel_4 = Panel(lng_2)
lng_3 = ListLength(List=pdecon_2.XComponent)
lng_4 = ListLength(List=pdecon_3.XComponent)
ins = InsertItems(List=len, Item="0", Indices="0", Wrap=True)
ins_2 = InsertItems(List=len_2, Item="0", Indices="0", Wrap=True)
panel_5 = Panel(ins_2)
panel_6 = Panel(ins)
number_slider_6 = Slider(5, range=0..10)
multiplication_4 = Multiplication(A=ins, B=number_slider_6)
multiplication_5 = Multiplication(A=ins_2, B=number_slider_6)
python = PythonScript(
    layer_count=number_slider_4,
    layer_height=number_slider_5,
    a_len=lng_3,
    a_x=pdecon_2.XComponent,
    a_y=pdecon_2.YComponent,
    a_e=multiplication_4,
    b_len=lng_4,
    b_x=pdecon_3.XComponent,
    b_y=pdecon_3.YComponent,
    b_e=multiplication_5)  # -> out, gcode; inputs layer_count: Int32, a_x: list, a_y: list, a_e: list, b_x: list, b_y: list, b_e: list
# ---------- python: Python ----------
gcode = []

z = 0
EA = 0
EB = 0



for j in range(layer_count):
    
    z += layer_height
    gcode.append("G1 Z" + str(z) + " F3250") #F
    
    for i in range(a_len):
        EA += float(a_e[i])
        a_test = "G1 X" + str(a_x[i]) + " Y" + str(a_y[i]) + " E" + str(EA)
        gcode.append(a_test)

    EA = 0    
    gcode.append("G92 E0")

    
    
    z += layer_height
    gcode.append("G1 Z" + str(z))
    

    # gcode.append("; Hello")

    for i in range(b_len):
        EB += float(b_e[i])
        b_test = "G1 X" + str(b_x[i]) + " Y" + str(b_y[i]) + " E" + str(EB)
        gcode.append(b_test)
    
    EB = 0
    gcode.append("G92 E0")
# ---------- end python ----------
panel_7 = Panel(python.gcode)
panel_8 = Panel("""Hello World
Hello Python""")
txt = Text(python.gcode)

# ---- group: file_name
panel_9 = Panel("181019")

# ----
list = ValueList({"txt": 1, "gcode": 2}, selected="gcode")
button = Button()
gh_cpython = GH_CPython(PATH="C:\Users\yoshioca\Desktop\", File_Name=panel_9, File_Type=list, MSG=txt, TF=button)  # -> a, debug; inputs PATH: list, File_Name: list, File_Type: list, MSG: list, TF: list
# ---------- gh_cpython: Python ----------
def TYPE(num):
    if num == 1:
        type = ".txt"
    elif num == 2:
        type = ".gcode"
    return type


debug = []

path_set = str(PATH)
file_name = str(File_Name)
file_type = TYPE(File_Type)
msg = MSG



#debug.append(MSG[1])


for i in xrange(len(msg)):
    debug.append(msg[i])
    if i < len(msg)-1:
        debug.append("\n")



path_out = path_set + "\\" + file_name + file_type

a = path_out


if TF:
    f = open(path_out, "w")
    f.writelines(debug)
    f.close
# ---------- end gh_cpython ----------
panel_10 = Panel(button)
panel_11 = Panel(gh_cpython.a)
panel_12 = Panel(gh_cpython.debug)
