# Grasshopper definition Write-gcode-ver3-Desktop.ghx (Grasshopper 0.9.76)
# plug-ins: Python Interpreter, GH_CPython

# ---- group: size
panel = Panel("60")

# ---- group: Grid
number_slider = Slider(4, range=0..100)

# ----
rectangle = Rectangle(Plane=PlaneXY(0, 0, 0), XSize="0 to 200", YSize="0 to 200", Radius=0)  # -> Rectangle, Length
crv = Curve(rectangle.Rectangle)

# ---- group: layer_height
number_slider_2 = Slider(0.2, range=0.1..30)

# ---- group: Margin
number_slider_3 = Slider(2, range=1..200)

# ---- group: layer_count
number_slider_4 = Slider(20, range=1..350)

# ---- group: W
number_slider_5 = Slider(8, range=0..100)

# ---- group: size
panel_2 = Panel("60")

# ---- group: Grid
number_slider_6 = Slider(4, range=0..100)

# ---- group: layer_height
number_slider_7 = Slider(0.2, range=0.1..30)

# ----
number_slider_8 = Slider(40, range=0..1000)

# ---- group: Margin
number_slider_9 = Slider(2, range=1..200)

# ---- group: layer_count
number_slider_10 = Slider(20, range=1..350)

# ---- group: W
number_slider_11 = Slider(4, range=0..100)

# ----
number_slider_12 = Slider(40, range=0..1000)
multiplication = Multiplication(A=number_slider_4, B=number_slider_2)
multiplication_2 = Multiplication(A=multiplication, B="2")

# ---- group: Printing Height
panel_3 = Panel(multiplication_2)

# ----
multiplication_3 = Multiplication(A=number_slider_10, B=number_slider_7)
neg = Negative(Value=number_slider_3)
division = Division(A="65", B=number_slider_5)
addition = Addition(A=panel, B=number_slider_3)
division_2 = Division(A=panel, B=number_slider)
addition_2 = Addition(A=panel, B=number_slider_3)
multiplication_4 = Multiplication(A=multiplication_3, B="2")

# ---- group: Printing Height
panel_4 = Panel(multiplication_4)

# ----
neg_2 = Negative(Value=number_slider_9)
Y = UnitY(Factor=neg)
division_3 = Division(A="24", B=number_slider_11)
addition_3 = Addition(A=Slider(100, range=0..100), B=number_slider_9)
pt = ConstructPoint(XCoordinate=Slider(40, range=0..1000), YCoordinate=Slider(150, range=0..1000), ZCoordinate=0)
addition_4 = Addition(A=addition, B=number_slider_3)
division_4 = Division(A=panel_2, B=number_slider_6)
pt_2 = ConstructPoint(XCoordinate=number_slider_8, YCoordinate=number_slider_8, ZCoordinate=0)
neg_3 = Negative(Value=number_slider_3)
addition_5 = Addition(A=addition_2, B=number_slider_3)
addition_6 = Addition(A=panel_2, B=number_slider_9)
neg_4 = Negative(Value=addition_4)
Y_2 = UnitY(Factor=addition)
X = UnitX(Factor=number_slider_5)
neg_5 = Negative(Value=addition_5)
Y_3 = UnitY(Factor=neg_3)
Y_4 = UnitY(Factor=neg_2)
pt_3 = ConstructPoint(XCoordinate=Slider(20, range=0..1000), YCoordinate=Slider(20, range=0..1000), ZCoordinate=0)
X_2 = UnitX(Factor=number_slider)
Y_5 = UnitY(Factor=addition_2)
addition_7 = Addition(A=addition_3, B=number_slider_9)
Y_6 = UnitY(Factor=neg_4)
pt_4 = ConstructPoint(XCoordinate=number_slider_12, YCoordinate=number_slider_12, ZCoordinate=0)
neg_6 = Negative(Value=number_slider_9)
addition_8 = Addition(A=addition_6, B=number_slider_9)
preview = CustomPreview(Geometry=crv, Shader=ColourSwatch(SwatchColor=RGB(255, 255, 255)))
Y_7 = UnitY(Factor=neg_5)
neg_7 = Negative(Value=addition_7)
Y_8 = UnitY(Factor=addition_3)
X_3 = UnitX(Factor=number_slider_11)
neg_8 = Negative(Value=addition_8)
Y_9 = UnitY(Factor=neg_6)
X_4 = UnitX(Factor=number_slider_6)
Y_10 = UnitY(Factor=addition_6)
Y_11 = UnitY(Factor=neg_7)
move = Move(Geometry=pt, Motion=Y)  # -> Geometry, Transform
Y_12 = UnitY(Factor=neg_8)
move_2 = Move(Geometry=pt, Motion=Y_2)  # -> Geometry, Transform
move_3 = Move(Geometry=move_2.Geometry, Motion=X)  # -> Geometry, Transform
move_4 = Move(Geometry=move_3.Geometry, Motion=Y_6)  # -> Geometry, Transform
move_5 = Move(Geometry=move_4.Geometry, Motion=X)  # -> Geometry, Transform
move_6 = Move(Geometry=pt_2, Motion=Y_3)  # -> Geometry, Transform
move_7 = Move(Geometry=pt_2, Motion=Y_5)  # -> Geometry, Transform
move_8 = Move(Geometry=move_7.Geometry, Motion=X_2)  # -> Geometry, Transform
move_9 = Move(Geometry=move_8.Geometry, Motion=Y_7)  # -> Geometry, Transform
move_10 = Move(Geometry=move_9.Geometry, Motion=X_2)  # -> Geometry, Transform
move_11 = Move(Geometry=pt_3, Motion=Y_4)  # -> Geometry, Transform
move_12 = Move(Geometry=pt_3, Motion=Y_8)  # -> Geometry, Transform
move_13 = Move(Geometry=move_12.Geometry, Motion=X_3)  # -> Geometry, Transform
move_14 = Move(Geometry=move_13.Geometry, Motion=Y_11)  # -> Geometry, Transform
move_15 = Move(Geometry=move_14.Geometry, Motion=X_3)  # -> Geometry, Transform
integer_division = IntegerDivision(A=division, B="2")
integer_division_2 = IntegerDivision(A=division_2, B="2")
move_16 = Move(Geometry=pt_4, Motion=Y_9)  # -> Geometry, Transform
move_17 = Move(Geometry=pt_4, Motion=Y_10)  # -> Geometry, Transform
move_18 = Move(Geometry=move_17.Geometry, Motion=X_4)  # -> Geometry, Transform
move_19 = Move(Geometry=move_18.Geometry, Motion=Y_12)  # -> Geometry, Transform
move_20 = Move(Geometry=move_19.Geometry, Motion=X_4)  # -> Geometry, Transform
merge = Merge(Data1=move.Geometry, Data2=move_2.Geometry, Data3=move_3.Geometry, Data4=move_4.Geometry, Data5=move_5.Geometry)
multiplication_5 = Multiplication(A=number_slider_5, B="2")
integer_division_3 = IntegerDivision(A=division_3, B="2")
integer_division_4 = IntegerDivision(A=division_4, B="2")
multiplication_6 = Multiplication(A=number_slider, B="2")
merge_2 = Merge(Data1=move_11.Geometry, Data2=move_12.Geometry, Data3=move_13.Geometry, Data4=move_14.Geometry, Data5=move_15.Geometry)
multiplication_7 = Multiplication(A=number_slider_11, B="2")
merge_3 = Merge(Data1=move_6.Geometry, Data2=move_7.Geometry, Data3=move_8.Geometry, Data4=move_9.Geometry, Data5=move_10.Geometry)
multiplication_8 = Multiplication(A=number_slider_6, B="2")
series = Series(Start=0, Step=multiplication_5, Count=integer_division)
pline = PolyLine(Vertices=merge, Closed=False)
series_2 = Series(Start=0, Step=multiplication_6, Count=integer_division_2)
merge_4 = Merge(Data1=move_16.Geometry, Data2=move_17.Geometry, Data3=move_18.Geometry, Data4=move_19.Geometry, Data5=move_20.Geometry)
pline_2 = PolyLine(Vertices=merge_3, Closed=False)
X_5 = UnitX(Factor=series)
X_6 = UnitX(Factor=series_2)
series_3 = Series(Start=0, Step=multiplication_7, Count=integer_division_3)
pline_3 = PolyLine(Vertices=merge_2, Closed=False)
series_4 = Series(Start=0, Step=multiplication_8, Count=integer_division_4)
pline_4 = PolyLine(Vertices=merge_4, Closed=False)
move_21 = Move(Geometry=pline, Motion=X_5)  # -> Geometry, Transform
X_7 = UnitX(Factor=series_3)
move_22 = Move(Geometry=pline_2, Motion=X_6)  # -> Geometry, Transform
X_8 = UnitX(Factor=series_4)
vec2pt = Vector2Pt(PointA=move_6.Geometry, PointB=move_7.Geometry, Unitize=False)  # -> Vector, Length
join = JoinCurves(Curves=move_21.Geometry, Preserve=False)
join_2 = JoinCurves(Curves=move_22.Geometry, Preserve=False)
move_23 = Move(Geometry=pline_3, Motion=X_7)  # -> Geometry, Transform
move_24 = Move(Geometry=pline_4, Motion=X_8)  # -> Geometry, Transform
end = EndPoints(Curve=join_2)  # -> Start, End
move_25 = Move(Geometry=end.End, Motion=vec2pt.Vector)  # -> Geometry, Transform
vec2pt_2 = Vector2Pt(PointA=move_16.Geometry, PointB=move_17.Geometry, Unitize=False)  # -> Vector, Length
join_3 = JoinCurves(Curves=move_23.Geometry, Preserve=False)
join_4 = JoinCurves(Curves=move_24.Geometry, Preserve=False)
ln = Line(StartPoint=end.End, EndPoint=move_25.Geometry)
merge_5 = Merge(Data1=join_2, Data2=ln)
end_2 = EndPoints(Curve=join_4)  # -> Start, End
move_26 = Move(Geometry=end_2.End, Motion=vec2pt_2.Vector)  # -> Geometry, Transform
crv_2 = Curve(<curve referenced from the Rhino model>)
crv_3 = Curve(<curve referenced from the Rhino model>)
ln_2 = Line(StartPoint=end_2.End, EndPoint=move_26.Geometry)
join_5 = JoinCurves(Curves=merge_5, Preserve=False)
merge_6 = Merge(Data1=join_4, Data2=ln_2)
crv_4 = Curve(join_5)
Z = UnitZ(Factor=number_slider_2)
loft = Loft(Curves=[crv_2, crv_3], Options={Adjust=False, Closed=False, LoftEnds=0, LoftSimp=0, LoftType=0, Rebuild=10, Refit=0.01})
join_6 = JoinCurves(Curves=merge_6, Preserve=False)
panel_5 = Panel(join_5)
move_27 = Move(Geometry=join, Motion=Z)  # -> Geometry, Transform
crv_5 = Curve(join_6)
bbox = BoundingBox(Content=crv_4, Plane=PlaneXY(0, 0, 0))  # -> Box, Box_2
Z_2 = UnitZ(Factor=number_slider_7)
panel_6 = Panel(join_6)
area = Area(Geometry=bbox.Box_2)  # -> Area, Centroid
sdivide = DivideSurface(Surface=loft, UCount=Slider(11, range=0..100), VCount=Slider(27, range=0..100))  # -> Points, Normals, Parameters
move_28 = Move(Geometry=join_3, Motion=Z_2)  # -> Geometry, Transform
bbox_2 = BoundingBox(Content=crv_5, Plane=PlaneXY(0, 0, 0))  # -> Box, Box_2
pdecon = Deconstruct(Point=area.Centroid)  # -> XComponent, YComponent, ZComponent
area_2 = Area(Geometry=bbox_2.Box_2)  # -> Area, Centroid
pt_5 = ConstructPoint(XCoordinate=pdecon.XComponent, YCoordinate=pdecon.YComponent, ZCoordinate=0)
flip = FlipMatrix(Data=sdivide.Points)
flip_2 = FlipMatrix(Data=sdivide.Points)
pdecon_2 = Deconstruct(Point=area_2.Centroid)  # -> XComponent, YComponent, ZComponent
flip_3 = FlipMatrix(Data=flip)
rotate = Rotate(Geometry=crv_4, Angle="0.5 * pi", Plane=pt_5)  # -> Geometry, Transform
merge_7 = Merge(Data2=crv_4, Data3=rotate.Geometry)  # -> flatten(Result)
crv_6 = Curve(merge_7)
pt_6 = ConstructPoint(XCoordinate=pdecon_2.XComponent, YCoordinate=pdecon_2.YComponent, ZCoordinate=0)
dispatch = Dispatch(List=flip_2, DispatchPattern=[True, False])  # -> ListA, ListB
crv_7 = Curve(rotate.Geometry)
dispatch_2 = Dispatch(List=flip_3, DispatchPattern=[True, False])  # -> ListA, ListB
rotate_2 = Rotate(Geometry=crv_5, Angle="0.5 * pi", Plane=pt_6)  # -> Geometry, Transform
disc = Discontinuity(Curve=crv_4, Level=1)  # -> Points, Parameters
flip_4 = FlipMatrix(Data=dispatch.ListA)
flip_5 = FlipMatrix(Data=dispatch.ListB)
crv_8 = Curve(rotate_2.Geometry)
flip_6 = FlipMatrix(Data=dispatch_2.ListA)
flip_7 = FlipMatrix(Data=dispatch_2.ListB)
disc_2 = Discontinuity(Curve=crv_5, Level=1)  # -> Points, Parameters
viewer = ParamViewer(disc.Points)
rev = ReverseList(List=flip_5)
multiplication_9 = Multiplication(A=number_slider_2, B="2")
viewer_2 = ParamViewer(flip_4)
crv_9 = Curve(move_27.Geometry)
rev_2 = ReverseList(List=flip_7)
viewer_3 = ParamViewer(disc_2.Points)
merge_8 = Merge(Data1=flip_4, Data2=rev)  # -> flatten(Result)
series_5 = Series(Start=number_slider_2, Step=multiplication_9, Count=number_slider_4)
flatten = FlattenTree(Tree=crv_9, Path="{0}")
series_6 = Series(Start=multiplication_9, Step=multiplication_9, Count=number_slider_4)
multiplication_10 = Multiplication(A=number_slider_7, B="2")
merge_9 = Merge(Data1=flip_6, Data2=rev_2)  # -> flatten(Result)
crv_10 = Curve(move_28.Geometry)
Z_3 = UnitZ(Factor=series_5)
Z_4 = UnitZ(Factor=series_6)

# ---- group: Speed
number_slider_13 = Slider(1000, range=1000..5000)

# ----
series_7 = Series(Start=number_slider_7, Step=multiplication_10, Count=number_slider_10)
flatten_2 = FlattenTree(Tree=crv_10, Path="{0}")
series_8 = Series(Start=multiplication_10, Step=multiplication_10, Count=number_slider_10)
pline_5 = PolyLine(Vertices=merge_8, Closed=False)
pline_6 = PolyLine(Vertices=merge_9, Closed=False)
move_29 = Move(Geometry=crv_4, Motion=Z_3)  # -> Geometry, Transform
move_30 = Move(Geometry=crv_7, Motion=Z_4)  # -> Geometry, Transform
number_slider_14 = Slider(0.2, range=0..1)
Z_5 = UnitZ(Factor=series_7)
Z_6 = UnitZ(Factor=series_8)

# ---- group: Speed
number_slider_15 = Slider(1000, range=1000..5000)

# ---- group: amp
number_slider_16 = Slider(0.1, range=0..1)

# ----
graft = GraftTree(Tree=move_29.Geometry, IncludeEmptyLists=True, IncludeNullItems=True)
graft_2 = GraftTree(Tree=move_30.Geometry, IncludeEmptyLists=True, IncludeNullItems=True)
disc_3 = Discontinuity(Curve=flatten, Level=1)  # -> Points, Parameters
move_31 = Move(Geometry=crv_5, Motion=Z_5)  # -> Geometry, Transform
move_32 = Move(Geometry=crv_8, Motion=Z_6)  # -> Geometry, Transform
shift = ShiftList(List=disc_3.Points, Shift="1", Wrap=True)
panel_7 = Panel(disc_3.Points)
merge_10 = Merge(Data1=pline_5, Data2=pline_6, Data3=pline_5, Data4=pline_6)
simplify = SimplifyTree(Tree=graft, Front=False)
simplify_2 = SimplifyTree(Tree=graft_2, Front=False)
series_9 = Series(Start=number_slider_14, Step=number_slider_14, Count=Slider(4, range=0..10))

# ---- group: amp
number_slider_17 = Slider(0.1, range=0..1)

# ----
graft_3 = GraftTree(Tree=move_31.Geometry, IncludeEmptyLists=True, IncludeNullItems=True)
pdecon_3 = Deconstruct(Point=disc_3.Points)  # -> XComponent, YComponent, ZComponent
graft_4 = GraftTree(Tree=move_32.Geometry, IncludeEmptyLists=True, IncludeNullItems=True)
disc_4 = Discontinuity(Curve=flatten_2, Level=1)  # -> Points, Parameters
Z_7 = UnitZ(Factor=series_9)
shift_2 = ShiftList(List=disc_4.Points, Shift="1", Wrap=True)
dist = Distance(PointA=disc_3.Points, PointB=shift)
panel_8 = Panel(disc_4.Points)
simplify_3 = SimplifyTree(Tree=graft_3, Front=False)
simplify_4 = SimplifyTree(Tree=graft_4, Front=False)
merge_11 = Merge(Data1=simplify, Data2=simplify_2)
num = Number(pdecon_3.YComponent)
num_2 = Number(pdecon_3.ZComponent)
num_3 = Number(pdecon_3.XComponent)
viewer_4 = ParamViewer(pline_5)
pdecon_4 = Deconstruct(Point=disc_4.Points)  # -> XComponent, YComponent, ZComponent
lng = ListLength(List=num_3)  # -> flatten(Length)
rev_3 = ReverseList(List=dist)
flatten_3 = FlattenTree(Tree=num, Path="{0}")
flatten_4 = FlattenTree(Tree=num_2, Path="{0}")
flatten_5 = FlattenTree(Tree=num_3, Path="{0}")
dist_2 = Distance(PointA=disc_4.Points, PointB=shift_2)
merge_12 = Merge(Data1=simplify_3, Data2=simplify_4)
num_4 = Number(pdecon_4.YComponent)
num_5 = Number(pdecon_4.ZComponent)
num_6 = Number(pdecon_4.XComponent)
split = SplitList(List=rev_3, Index="1")  # -> ListA, ListB
lng_2 = ListLength(List=num_6)  # -> flatten(Length)
rev_4 = ReverseList(List=dist_2)
flatten_6 = FlattenTree(Tree=num_4, Path="{0}")
flatten_7 = FlattenTree(Tree=num_5, Path="{0}")
flatten_8 = FlattenTree(Tree=num_6, Path="{0}")
move_33 = Move(Geometry=merge_10, Motion=Z_7)  # -> Geometry, Transform
rev_5 = ReverseList(List=split.ListB)
split_2 = SplitList(List=rev_4, Index="1")  # -> ListA, ListB
crv_11 = Curve(merge_11)
ins = InsertItems(List=rev_5, Item="0", Indices="0", Wrap=True)
flatten_9 = FlattenTree(Tree=crv_11, Path="{0}")
rev_6 = ReverseList(List=split_2.ListB)
flatten_10 = FlattenTree(Tree=ins, Path="{0}")  # -> simplify(Tree)
crv_12 = Curve(move_33.Geometry)
disc_5 = Discontinuity(Curve=flatten_9, Level=1)  # -> Points, Parameters
ins_2 = InsertItems(List=rev_6, Item="0", Indices="0", Wrap=True)
viewer_5 = ParamViewer(flatten_10)
flatten_11 = FlattenTree(Tree=crv_12, Path="{0}")
multiplication_11 = Multiplication(A=flatten_10, B=number_slider_16)
panel_9 = Panel(lng)
panel_10 = Panel(disc_5.Points)
flatten_12 = FlattenTree(Tree=ins_2, Path="{0}")  # -> simplify(Tree)
disc_6 = Discontinuity(Curve=flatten_11, Level=1)  # -> Points, Parameters
viewer_6 = ParamViewer(flatten_12)
flip_8 = FlipMatrix(Data=disc_5.Points)
multiplication_12 = Multiplication(A=flatten_12, B=number_slider_17)
python = PythonScript(x=flatten_5, y=flatten_3, z=flatten_4, e=multiplication_11, u=lng, speed=number_slider_13)  # -> out, a; inputs x: list, y: list, z: list, e: list, u: list
# ---------- python: Python ----------
_start = 0
_end = 0

gcode = []


gcode.append("; Skirt")
gcode.append("G1 Z30" + " F" + str(speed))


for i in xrange(len(u)):
    _end += u[i]
    extrude = 0
   

    se = "; layer " + str(i)# + ", " + str(_start) + "-" + str(_end)
    gcode.append(se)
    
    for j in xrange(_start, _end):
        extrude += float(e[j])
        z_tmp = float(z[0]) + 30
        text = "G1 X" + str(x[j]) + " Y" + str(y[j]) + " Z" + str(z[j]) + " E" + str(extrude)
        gcode.append(text)

    gcode.append("G1 Z " + str(z_tmp))
    gcode.append("G92 E0")
    #print(_start, _end)
    _start = _end + 1

    
a = gcode
# ---------- end python ----------
panel_12 = Panel(lng_2)
panel_13 = Panel(disc_6.Points)
shift_3 = ShiftList(List=disc_5.Points, Shift="1", Wrap=True)
pdecon_5 = Deconstruct(Point=disc_5.Points)  # -> XComponent, YComponent, ZComponent
flip_9 = FlipMatrix(Data=disc_6.Points)
python_2 = PythonScript(x=flatten_8, y=flatten_6, z=flatten_7, e=multiplication_12, u=lng_2, speed=number_slider_15)  # -> out, a; inputs x: list, y: list, z: list, e: list, u: list; same code as python
shift_4 = ShiftList(List=disc_6.Points, Shift="1", Wrap=True)
dist_3 = Distance(PointA=disc_5.Points, PointB=shift_3)
num_7 = Number(pdecon_5.YComponent)
num_8 = Number(pdecon_5.ZComponent)
num_9 = Number(pdecon_5.XComponent)
pdecon_6 = Deconstruct(Point=disc_6.Points)  # -> XComponent, YComponent, ZComponent
lng_3 = ListLength(List=num_9)  # -> flatten(Length)
rev_7 = ReverseList(List=dist_3)
flatten_13 = FlattenTree(Tree=num_7, Path="{0}")
flatten_14 = FlattenTree(Tree=num_8, Path="{0}")
flatten_15 = FlattenTree(Tree=num_9, Path="{0}")
dist_4 = Distance(PointA=disc_6.Points, PointB=shift_4)
panel_14 = Panel(python.a)
num_10 = Number(pdecon_6.YComponent)
num_11 = Number(pdecon_6.ZComponent)
num_12 = Number(pdecon_6.XComponent)
split_3 = SplitList(List=rev_7, Index="1")  # -> ListA, ListB
panel_15 = Panel(dist_3)
lng_4 = ListLength(List=num_12)  # -> flatten(Length)
rev_8 = ReverseList(List=dist_4)
flatten_16 = FlattenTree(Tree=num_10, Path="{0}")
flatten_17 = FlattenTree(Tree=num_11, Path="{0}")
flatten_18 = FlattenTree(Tree=num_12, Path="{0}")
panel_16 = Panel(python_2.a)
rev_9 = ReverseList(List=split_3.ListB)
split_4 = SplitList(List=rev_8, Index="1")  # -> ListA, ListB
multiplication_13 = Multiplication(A=number_slider_4, B="2")
item = ListItem(List=flatten_14, Index="-1", Wrap=True)
item_2 = ListItem(List=flatten_13, Index="-1", Wrap=True)
item_3 = ListItem(List=flatten_15, Index="-1", Wrap=True)
ins_3 = InsertItems(List=rev_9, Item="0", Indices="0", Wrap=True)
rev_10 = ReverseList(List=split_4.ListB)
panel_18 = Panel(item_3)
flatten_19 = FlattenTree(Tree=ins_3, Path="{0}")  # -> simplify(Tree)
multiplication_14 = Multiplication(A=number_slider_10, B="2")
item_4 = ListItem(List=flatten_17, Index="-1", Wrap=True)
item_5 = ListItem(List=flatten_16, Index="-1", Wrap=True)
item_6 = ListItem(List=flatten_18, Index="-1", Wrap=True)
ins_4 = InsertItems(List=rev_10, Item="0", Indices="0", Wrap=True)
viewer_7 = ParamViewer(flatten_15)
panel_19 = Panel(item_6)
multiplication_15 = Multiplication(A=flatten_19, B=number_slider_16)
panel_20 = Panel(lng_3)
flatten_20 = FlattenTree(Tree=ins_4, Path="{0}")  # -> simplify(Tree)
viewer_8 = ParamViewer(flatten_18)
multiplication_16 = Multiplication(A=flatten_20, B=number_slider_17)
panel_21 = Panel(lng_4)
item_7 = ListItem(List=multiplication_15, Index="-1", Wrap=True)
panel_22 = Panel(multiplication_15)
python_3 = PythonScript(x=flatten_15, y=flatten_13, z=flatten_14, e=multiplication_15, u=lng_3, speed=number_slider_13)  # -> out, a; inputs x: list, y: list, z: list, e: list, u: list
# ---------- python_3: Python ----------
_start = 0
_end = 0

x.append(130.0)
y.append(640.0)
z.append(525.0)
e.append(520.0)


gcode = []


gcode.append("; Body")
gcode.append("G1 Z30" + " F" + str(speed))


for i in xrange(len(u)):
    _end += u[i]


    se = "; layer " + str(i) + ": " + str(_start) + "-" + str(_end)
    gcode.append(se)
    extrude = 0
    
    for j in xrange(_start, _end):
        extrude += float(e[j])
        z_tmp = float(z[_end]) + 5
        text = "G1 X" + str(x[j]) + " Y" + str(y[j]) + " Z" + str(z[j]) + " E" + str(extrude)
        gcode.append(text)

    gcode.append("G1 Z " + str(z_tmp))
    gcode.append("G92 E0")
    _start = _end

    
a = gcode
# ---------- end python_3 ----------
panel_23 = Panel(item_7)
item_8 = ListItem(List=multiplication_16, Index="-1", Wrap=True)
panel_24 = Panel(multiplication_16)
python_4 = PythonScript(x=flatten_18, y=flatten_16, z=flatten_17, e=multiplication_16, u=lng_4, speed=number_slider_15)  # -> out, a; inputs x: list, y: list, z: list, e: list, u: list; same code as python_3
panel_25 = Panel(item_8)
panel_26 = Panel("""G90
M82
M106 S0
M104 S190 T0
M109 S190 T0""")
panel_27 = Panel("""G90
M82
M106 S0
M104 S190 T0
M109 S190 T0""")
panel_28 = Panel(python_3.a)
panel_29 = Panel(python_4.a)
txt = Text(python.a)
txt_2 = Text(python_3.a)
list = ValueList({"txt": 1, "gcode": 2}, selected="gcode")
txt_3 = Text(python_2.a)
txt_4 = Text(python_4.a)
list_2 = ValueList({"txt": 1, "gcode": 2}, selected="gcode")

# ---- group: file_name
panel_30 = Panel("181029-slab-Desktop")

panel_31 = Panel("181029-slab-Desktop")

# ----
button = Button()
export_gcode_component = GH_CPython(
    PATH="C:\Users\yoshioca\Desktop\",
    File_Name=panel_30,
    File_Type=list,
    layer_height=number_slider_2,
    layer_count=multiplication_13,
    extrude_amp=number_slider_16,
    HEADER=panel_26,
    SKIRT=txt,
    MSG=txt_2,
    TF=button)  # -> a, debug; inputs PATH: list, File_Name: list, File_Type: list, layer_height: list, layer_count: list, extrude_amp: list, HEADER: list, SKIRT: list, MSG: list, TF: list
# ---------- export_gcode_component: Python ----------
from datetime import datetime

def TYPE(num):
    if num == 1:
        type = ".txt"
    elif num == 2:
        type = ".gcode"
    return type


debug = []
comment = []

path_set = str(PATH)
file_name = str(File_Name)
file_type = TYPE(File_Type)
 


# HEADER gode
for i in xrange(len(HEADER)):
    debug.append(HEADER[i])
    debug.append("\n")

debug.append("\n")



# Skirt gode
##for i in xrange(len(SKIRT)):
##    debug.append(SKIRT[i])
##    debug.append("\n")

##debug.append("\n")


# Body gcode
for i in xrange(len(MSG)):
    debug.append(MSG[i])
    if i < len(MSG)-1:
        debug.append("\n")


path_out = path_set + "\\" + file_name + file_type

a = path_out

len = len(debug)

# for i in xrange(len):
#     print(debug[i])





if TF:
    now = "; Export Time - " + str(datetime.now().strftime("%Y/%m/%d %H:%M:%S"))
    comment.append(now)
    comment.append("\n")

    height = "; Layer Height(mm) - " + str(layer_height)
    comment.append(height)
    comment.append("\n")

    count = "; Layer Count - " + str(layer_count)
    comment.append(count)
    comment.append("\n")


    amp = "; Extrude Amp - " + str(extrude_amp)
    comment.append(amp)
    comment.append("\n")
    comment.append("\n")

    f = open(path_out, "w")
    f.writelines(comment)
    f.writelines(debug)
    f.close
# ---------- end export_gcode_component ----------
button_2 = Button()
export_gcode_component_2 = GH_CPython(
    PATH="C:\Users\yoshioca\Desktop\",
    File_Name=panel_31,
    File_Type=list_2,
    layer_height=number_slider_7,
    layer_count=multiplication_14,
    extrude_amp=number_slider_17,
    HEADER=panel_27,
    SKIRT=txt_3,
    MSG=txt_4,
    TF=button_2)  # -> a, debug; inputs PATH: list, File_Name: list, File_Type: list, layer_height: list, layer_count: list, extrude_amp: list, HEADER: list, SKIRT: list, MSG: list, TF: list
# ---------- export_gcode_component_2: Python ----------
from datetime import datetime

def TYPE(num):
    if num == 1:
        type = ".txt"
    elif num == 2:
        type = ".gcode"
    return type


debug = []
comment = []

path_set = str(PATH)
file_name = str(File_Name)
file_type = TYPE(File_Type)
 


# HEADER gode
for i in xrange(len(HEADER)):
    debug.append(HEADER[i])
    debug.append("\n")

debug.append("\n")



# Skirt gode
for i in xrange(len(SKIRT)):
    debug.append(SKIRT[i])
    debug.append("\n")

debug.append("\n")


# Body gcode
for i in xrange(len(MSG)):
    debug.append(MSG[i])
    if i < len(MSG)-1:
        debug.append("\n")


path_out = path_set + "\\" + file_name + file_type

a = path_out

len = len(debug)

# for i in xrange(len):
#     print(debug[i])





if TF:
    now = "; Export Time - " + str(datetime.now().strftime("%Y/%m/%d %H:%M:%S"))
    comment.append(now)
    comment.append("\n")

    height = "; Layer Height(mm) - " + str(layer_height)
    comment.append(height)
    comment.append("\n")

    count = "; Layer Count - " + str(layer_count)
    comment.append(count)
    comment.append("\n")


    amp = "; Extrude Amp - " + str(extrude_amp)
    comment.append(amp)
    comment.append("\n")
    comment.append("\n")

    f = open(path_out, "w")
    f.writelines(comment)
    f.writelines(debug)
    f.close
# ---------- end export_gcode_component_2 ----------
panel_32 = Panel(button)
panel_33 = Panel(export_gcode_component.a)
panel_34 = Panel(button_2)
panel_35 = Panel(export_gcode_component.debug)
panel_36 = Panel(export_gcode_component_2.a)
panel_37 = Panel(export_gcode_component_2.debug)
