# Grasshopper definition Write-gcode-ver3.ghx (Grasshopper 0.9.76)
# plug-ins: Python Interpreter, GH_CPython

rectangle = Rectangle(Plane=PlaneXY(0, 0, 0), XSize="0 to 800", YSize="0 to 800", Radius=0)  # -> Rectangle, Length
crv = Curve(rectangle.Rectangle)

# ---- group: layer_height
number_slider = Slider(1.5, range=0.1..30)

# ---- group: W
number_slider_2 = Slider(6, range=0..100)

number_slider_3 = Slider(20, range=0..100)

# ----
number_slider_4 = Slider(150, range=0..1000)

# ---- group: Margin
number_slider_5 = Slider(10, range=1..200)

# ---- group: size
panel = Panel("500")

# ---- group: Margin
number_slider_6 = Slider(10, range=1..30)

# ---- group: size
panel_2 = Panel("500")

# ---- group: layer_count
number_slider_7 = Slider(175, range=1..350)

# ----
multiplication = Multiplication(A=number_slider_7, B=number_slider)
multiplication_2 = Multiplication(A=multiplication, B="2")
neg = Negative(Value=number_slider_5)
division = Division(A="65", B=number_slider_2)
addition = Addition(A=panel, B=number_slider_5)
division_2 = Division(A=panel_2, B=number_slider_3)
addition_2 = Addition(A=panel_2, B=number_slider_6)
Y = UnitY(Factor=neg)
pt = ConstructPoint(XCoordinate=Slider(40, range=0..1000), YCoordinate=Slider(150, range=0..1000), ZCoordinate=0)
addition_3 = Addition(A=addition, B=number_slider_5)
pt_2 = ConstructPoint(XCoordinate=number_slider_4, YCoordinate=number_slider_4, ZCoordinate=0)

# ---- group: Printing Height
panel_3 = Panel(multiplication_2)

# ----
neg_2 = Negative(Value=number_slider_6)
addition_4 = Addition(A=addition_2, B=number_slider_6)
neg_3 = Negative(Value=addition_3)
Y_2 = UnitY(Factor=addition)
X = UnitX(Factor=number_slider_2)
neg_4 = Negative(Value=addition_4)
Y_3 = UnitY(Factor=neg_2)
X_2 = UnitX(Factor=number_slider_3)
Y_4 = UnitY(Factor=addition_2)
Y_5 = UnitY(Factor=neg_3)
preview = CustomPreview(Geometry=crv, Shader=ColourSwatch(SwatchColor=RGB(255, 255, 255)))
Y_6 = UnitY(Factor=neg_4)
move = Move(Geometry=pt, Motion=Y)  # -> Geometry, Transform
move_2 = Move(Geometry=pt, Motion=Y_2)  # -> Geometry, Transform
move_3 = Move(Geometry=move_2.Geometry, Motion=X)  # -> Geometry, Transform
move_4 = Move(Geometry=move_3.Geometry, Motion=Y_5)  # -> Geometry, Transform
move_5 = Move(Geometry=move_4.Geometry, Motion=X)  # -> Geometry, Transform
move_6 = Move(Geometry=pt_2, Motion=Y_3)  # -> Geometry, Transform
move_7 = Move(Geometry=pt_2, Motion=Y_4)  # -> Geometry, Transform
move_8 = Move(Geometry=move_7.Geometry, Motion=X_2)  # -> Geometry, Transform
move_9 = Move(Geometry=move_8.Geometry, Motion=Y_6)  # -> Geometry, Transform
move_10 = Move(Geometry=move_9.Geometry, Motion=X_2)  # -> Geometry, Transform
integer_division = IntegerDivision(A=division, B="2")
integer_division_2 = IntegerDivision(A=division_2, B="2")
merge = Merge(Data1=move.Geometry, Data2=move_2.Geometry, Data3=move_3.Geometry, Data4=move_4.Geometry, Data5=move_5.Geometry)
multiplication_3 = Multiplication(A=number_slider_2, B="2")
multiplication_4 = Multiplication(A=number_slider_3, B="2")
merge_2 = Merge(Data1=move_6.Geometry, Data2=move_7.Geometry, Data3=move_8.Geometry, Data4=move_9.Geometry, Data5=move_10.Geometry)
series = Series(Start=0, Step=multiplication_3, Count=integer_division)
pline = PolyLine(Vertices=merge, Closed=False)
series_2 = Series(Start=0, Step=multiplication_4, Count=integer_division_2)
pline_2 = PolyLine(Vertices=merge_2, Closed=False)
X_3 = UnitX(Factor=series)
X_4 = UnitX(Factor=series_2)
move_11 = Move(Geometry=pline, Motion=X_3)  # -> Geometry, Transform
move_12 = Move(Geometry=pline_2, Motion=X_4)  # -> Geometry, Transform
vec2pt = Vector2Pt(PointA=move_6.Geometry, PointB=move_7.Geometry, Unitize=False)  # -> Vector, Length
join = JoinCurves(Curves=move_11.Geometry, Preserve=False)
join_2 = JoinCurves(Curves=move_12.Geometry, Preserve=False)
end = EndPoints(Curve=join_2)  # -> Start, End
move_13 = Move(Geometry=end.End, Motion=vec2pt.Vector)  # -> Geometry, Transform
ln = Line(StartPoint=end.End, EndPoint=move_13.Geometry)
merge_3 = Merge(Data1=join_2, Data2=ln)
join_3 = JoinCurves(Curves=merge_3, Preserve=False)
crv_2 = Curve(join_3)
Z = UnitZ(Factor=number_slider)
panel_4 = Panel(join_3)
move_14 = Move(Geometry=join, Motion=Z)  # -> Geometry, Transform
bbox = BoundingBox(Content=crv_2, Plane=PlaneXY(0, 0, 0))  # -> Box, Box_2
area = Area(Geometry=bbox.Box_2)  # -> Area, Centroid
pdecon = Deconstruct(Point=area.Centroid)  # -> XComponent, YComponent, ZComponent
pt_3 = ConstructPoint(XCoordinate=pdecon.XComponent, YCoordinate=pdecon.YComponent, ZCoordinate=0)
rotate = Rotate(Geometry=crv_2, Angle="0.5 * pi", Plane=pt_3)  # -> Geometry, Transform
merge_4 = Merge(Data1=join, Data2=crv_2, Data3=rotate.Geometry)  # -> flatten(Result)
crv_3 = Curve(merge_4)
crv_4 = Curve(rotate.Geometry)
disc = Discontinuity(Curve=crv_2, Level=1)  # -> Points, Parameters
viewer = ParamViewer(disc.Points)
multiplication_5 = Multiplication(A=number_slider, B="2")
crv_5 = Curve(move_14.Geometry)
series_3 = Series(Start=number_slider, Step=multiplication_5, Count=number_slider_7)
flatten = FlattenTree(Tree=crv_5, Path="{0}")
series_4 = Series(Start=multiplication_5, Step=multiplication_5, Count=number_slider_7)
Z_2 = UnitZ(Factor=series_3)
Z_3 = UnitZ(Factor=series_4)
move_15 = Move(Geometry=crv_2, Motion=Z_2)  # -> Geometry, Transform
move_16 = Move(Geometry=crv_4, Motion=Z_3)  # -> Geometry, Transform
graft = GraftTree(Tree=move_15.Geometry, IncludeEmptyLists=True, IncludeNullItems=True)
graft_2 = GraftTree(Tree=move_16.Geometry, IncludeEmptyLists=True, IncludeNullItems=True)
disc_2 = Discontinuity(Curve=flatten, Level=1)  # -> Points, Parameters
shift = ShiftList(List=disc_2.Points, Shift="1", Wrap=True)
panel_5 = Panel(disc_2.Points)
simplify = SimplifyTree(Tree=graft, Front=False)
simplify_2 = SimplifyTree(Tree=graft_2, Front=False)
pdecon_2 = Deconstruct(Point=disc_2.Points)  # -> XComponent, YComponent, ZComponent
dist = Distance(PointA=disc_2.Points, PointB=shift)
merge_5 = Merge(Data1=simplify, Data2=simplify_2)
num = Number(pdecon_2.YComponent)
num_2 = Number(pdecon_2.ZComponent)
num_3 = Number(pdecon_2.XComponent)
number_slider_8 = Slider(1, range=1..10)
lng = ListLength(List=num_3)  # -> flatten(Length)
rev = ReverseList(List=dist)
flatten_2 = FlattenTree(Tree=num, Path="{0}")
flatten_3 = FlattenTree(Tree=num_2, Path="{0}")
flatten_4 = FlattenTree(Tree=num_3, Path="{0}")
split = SplitList(List=rev, Index="1")  # -> ListA, ListB
rev_2 = ReverseList(List=split.ListB)
crv_6 = Curve(merge_5)
ins = InsertItems(List=rev_2, Item="0", Indices="0", Wrap=True)
flatten_5 = FlattenTree(Tree=crv_6, Path="{0}")
flatten_6 = FlattenTree(Tree=ins, Path="{0}")  # -> simplify(Tree)
disc_3 = Discontinuity(Curve=flatten_5, Level=1)  # -> Points, Parameters
viewer_2 = ParamViewer(flatten_6)
multiplication_6 = Multiplication(A=flatten_6, B=number_slider_8)
panel_6 = Panel(lng)
panel_7 = Panel(disc_3.Points)
flip = FlipMatrix(Data=disc_3.Points)
shift_2 = ShiftList(List=disc_3.Points, Shift="1", Wrap=True)
python = PythonScript(x=flatten_4, y=flatten_2, z=flatten_3, e=multiplication_6, u=lng)  # -> out, a; inputs x: list, y: list, z: list, e: list, u: list
# ---------- python: Python ----------
_start = 0
_end = 0

gcode = []


gcode.append("; Skirt")
gcode.append("G1 Z30" + " F4000")


for i in xrange(len(u)):
    _end += u[i]
    extrude = 0
   

    se = "; layer " + str(i)# + ", " + str(_start) + "-" + str(_end)
    gcode.append(se)
    
    for j in xrange(_start, _end):
        extrude += float(e[j])
        z_tmp = float(z[0]) + 30
        text = "G1 X" + str(x[j]) + " Y" + str(y[j]) + " Z" + str(z[j]) + " E" + str(extrude)
        gcode.append(text)

    gcode.append("G1 Z " + str(z_tmp))
    gcode.append("G92 E0")
    #print(_start, _end)
    _start = _end + 1

    
a = gcode
# ---------- end python ----------
pdecon_3 = Deconstruct(Point=disc_3.Points)  # -> XComponent, YComponent, ZComponent
dist_2 = Distance(PointA=disc_3.Points, PointB=shift_2)
num_4 = Number(pdecon_3.YComponent)
num_5 = Number(pdecon_3.ZComponent)
num_6 = Number(pdecon_3.XComponent)
lng_2 = ListLength(List=num_6)  # -> flatten(Length)
rev_3 = ReverseList(List=dist_2)
flatten_7 = FlattenTree(Tree=num_4, Path="{0}")
flatten_8 = FlattenTree(Tree=num_5, Path="{0}")
flatten_9 = FlattenTree(Tree=num_6, Path="{0}")
panel_9 = Panel(python.a)
split_2 = SplitList(List=rev_3, Index="1")  # -> ListA, ListB
panel_10 = Panel(dist_2)
rev_4 = ReverseList(List=split_2.ListB)
multiplication_7 = Multiplication(A=number_slider_7, B="2")
item = ListItem(List=flatten_8, Index="-1", Wrap=True)
item_2 = ListItem(List=flatten_7, Index="-1", Wrap=True)
item_3 = ListItem(List=flatten_9, Index="-1", Wrap=True)
ins_2 = InsertItems(List=rev_4, Item="0", Indices="0", Wrap=True)
panel_11 = Panel(item_3)
flatten_10 = FlattenTree(Tree=ins_2, Path="{0}")  # -> simplify(Tree)
viewer_3 = ParamViewer(flatten_9)
multiplication_8 = Multiplication(A=flatten_10, B=number_slider_8)
panel_12 = Panel(lng_2)
item_4 = ListItem(List=multiplication_8, Index="-1", Wrap=True)
panel_13 = Panel(multiplication_8)
panel_14 = Panel(item_4)
python_2 = PythonScript(x=flatten_9, y=flatten_7, z=flatten_8, e=multiplication_8, u=lng_2)  # -> out, a; inputs x: list, y: list, z: list, e: list, u: list
# ---------- python_2: Python ----------
_start = 0
_end = 0

x.append(130.0)
y.append(640.0)
z.append(525.0)
e.append(520.0)


gcode = []


gcode.append("; Body")
gcode.append("G1 Z30" + " F4000")


for i in xrange(len(u)):
    _end += u[i]


    se = "; layer " + str(i) + ": " + str(_start) + "-" + str(_end)
    gcode.append(se)
    extrude = 0
    
    for j in xrange(_start, _end+1):
        extrude += float(e[j])
        z_tmp = float(z[0]) + 30
        text = "G1 X" + str(x[j]) + " Y" + str(y[j]) + " Z" + str(z[j]) + " E" + str(extrude)
        gcode.append(text)

    gcode.append("G1 Z " + str(z_tmp))
    gcode.append("G92 E0")
    _start = _end + 1

    
a = gcode
# ---------- end python_2 ----------
python_3 = PythonScript()  # -> out, a
# ---------- python_3: Python ----------
for i in range(1,10+1):
    print(i)
# ---------- end python_3 ----------

# ---- group: Yoshida
panel_15 = Panel("""G90
M82
M106 S0
M104 S100 T0
M109 S100 T0""")

# ----
panel_16 = Panel(python_2.a)
txt = Text(python.a)
txt_2 = Text(python_2.a)
list = ValueList({"txt": 1, "gcode": 2}, selected="gcode")

# ---- group: file_name
panel_17 = Panel("181029")

# ----
button = Button()
export_gcode_component = GH_CPython(
    PATH="C:\Users\yoshioca\Desktop\",
    File_Name=panel_17,
    File_Type=list,
    layer_height=number_slider,
    layer_count=multiplication_7,
    extrude_amp=number_slider_8,
    HEADER=panel_15,
    SKIRT=txt,
    MSG=txt_2,
    TF=button)  # -> a, debug; inputs PATH: list, File_Name: list, File_Type: list, layer_height: list, layer_count: list, extrude_amp: list, HEADER: list, SKIRT: list, MSG: list, TF: list
# ---------- export_gcode_component: Python ----------
from datetime import datetime

def TYPE(num):
    if num == 1:
        type = ".txt"
    elif num == 2:
        type = ".gcode"
    return type


debug = []
comment = []

path_set = str(PATH)
file_name = str(File_Name)
file_type = TYPE(File_Type)
 


# HEADER gode
for i in xrange(len(HEADER)):
    debug.append(HEADER[i])
    debug.append("\n")

debug.append("\n")



# Skirt gode
for i in xrange(len(SKIRT)):
    debug.append(SKIRT[i])
    debug.append("\n")

debug.append("\n")


# Body gcode
for i in xrange(len(MSG)):
    debug.append(MSG[i])
    if i < len(MSG)-1:
        debug.append("\n")


path_out = path_set + "\\" + file_name + file_type

a = path_out

len = len(debug)

# for i in xrange(len):
#     print(debug[i])





if TF:
    now = "; Export Time - " + str(datetime.now().strftime("%Y/%m/%d %H:%M:%S"))
    comment.append(now)
    comment.append("\n")

    height = "; Layer Height(mm) - " + str(layer_height)
    comment.append(height)
    comment.append("\n")

    count = "; Layer Count - " + str(layer_count)
    comment.append(count)
    comment.append("\n")


    amp = "; Extrude Amp - " + str(extrude_amp)
    comment.append(amp)
    comment.append("\n")
    comment.append("\n")

    f = open(path_out, "w")
    f.writelines(comment)
    f.writelines(debug)
    f.close
# ---------- end export_gcode_component ----------
panel_18 = Panel(button)
panel_19 = Panel(export_gcode_component.a)
panel_20 = Panel(export_gcode_component.debug)
